# Dynamo graph dynamo-elevations.dyn "Изменение отметок" (Dynamo 2.17.0.3472)
# author: Abramov Y.I
# Смещение отметок характерных линий и профилей.
# packages: Civil3DToolkit 1.1.32

выберите_характерные_линии = ObjectsSelection()  # 2 picked in the model; graph input
смещение_по_высоте_м = DoubleInput(5)  # graph input
python_script = Python(IN[0]=выберите_характерные_линии, IN[1]=смещение_по_высоте_м)  # CPython3
# ---------- python_script.python (51 lines) ----------
import sys
import clr

clr.AddReference('AcMgd')
clr.AddReference('AcDbMgd')
clr.AddReference('AeccDbMgd')
clr.AddReference('Civil3DNodes')

import Autodesk.AutoCAD.ApplicationServices as acApp
from Autodesk.Civil.DynamoNodes.LandDevelopment import FeatureLine as C3DFeatureLine

# ── входные данные ──────────────────────────────────────────
raw_fls = IN[0]
delta   = float(IN[1])

if not isinstance(raw_fls, list):
    raw_fls = [raw_fls]
civil_objects = []
for item in raw_fls:
    if isinstance(item, list):
        civil_objects.extend(item)
    else:
        civil_objects.append(item)

acDoc  = acApp.Application.DocumentManager.MdiActiveDocument
report = []

try:
    with acDoc.LockDocument():
        for obj in civil_objects:
            if obj is None:
                continue
            try:
                # Приводим CivilObject → FeatureLine
                fl    = C3DFeatureLine.ByObject(obj)
                pts   = fl.GetAllPoints()
                count = len(pts)

                report.append("DEBUG: fl={} pts={}".format(fl, count))

                for i in range(count):
                    fl.SetPointRelativeElevationByIndex(i, delta)

                report.append("OK | FL: {} | точек: {}".format(fl.Name, count))
            except Exception as fl_ex:
                report.append("ERR | " + str(fl_ex))

except Exception as lock_ex:
    report = ["LOCK ERROR: " + str(lock_ex)]

OUT = report
# ----------------------------------------
watch = Watch(python_script)
выберите_профили = ObjectsSelection()  # 2 picked in the model; graph input
включить_профили = BoolSelector(false)  # graph input
python_script_2 = Python(IN[0]=выберите_профили, IN[1]=смещение_по_высоте_м, IN[2]=включить_профили)  # CPython3
# ---------- python_script_2.python (59 lines) ----------
import sys
import clr

clr.AddReference('AcMgd')
clr.AddReference('AcDbMgd')
clr.AddReference('AeccDbMgd')
clr.AddReference('Civil3DNodes')

import Autodesk.AutoCAD.ApplicationServices as acApp
import Autodesk.AutoCAD.DatabaseServices as acDb

raw_profiles = IN[0]
delta        = float(IN[1])
enabled      = IN[2]

if not enabled:
    OUT = ["Профили: пропущено"]
else:
    if not isinstance(raw_profiles, list):
        raw_profiles = [raw_profiles]

    civil_objects = []
    for item in raw_profiles:
        if isinstance(item, list):
            civil_objects.extend(item)
        else:
            civil_objects.append(item)

    acDoc  = acApp.Application.DocumentManager.MdiActiveDocument
    report = []

    try:
        with acDoc.LockDocument():
            with acDoc.Database.TransactionManager.StartTransaction() as tr:
                try:
                    for obj in civil_objects:
                        if obj is None:
                            continue
                        try:
                            oid         = obj.InternalObjectId
                            native_prof = tr.GetObject(
                                oid, acDb.OpenMode.ForWrite)
                            pvi_col     = native_prof.PVIs
                            pvi_count   = pvi_col.Count
                            for idx in range(pvi_count):
                                pvi = pvi_col[idx]
                                pvi.Elevation = pvi.Elevation + delta
                            report.append("OK | Profile: {} | PVI: {}".format(
                                native_prof.Name, pvi_count))
                        except Exception as p_ex:
                            report.append("ERR | " + str(p_ex))
                    tr.Commit()
                except Exception as tx_ex:
                    report.append("TRANSACTION ERROR: " + str(tx_ex))
                    tr.Abort()
    except Exception as lock_ex:
        report = ["LOCK ERROR: " + str(lock_ex)]

    OUT = report
# ----------------------------------------
watch_2 = Watch(python_script_2)
внимание = StringInput("Если профили отсутствуют - выберите любую характерную линию для пропуска.")  # graph input
